vi "Packages.gviweb"   [LabVIEW NXG 4.0.0]
# This template is for the Queued Message Handler design pattern. The Event Handling Loop generates messages based on user interface actions. The Message Handling Loop processes messages generated by the Event Handling Loop, or by other messages. The messages are string values, so new messages can be added easily to the Message Cases case structure in the Message Handling Loop. Each message cluster can also provide an optional value for Message Data,  which is a String that can be swapped to whatever type of data is required.
panel controls:
  "Search": string
  "First": bool
  "Previous": bool
  "Next": bool
  "Last": bool
  "Package Details": bool
  "Repo Type": i32[]
  "Repo Name": i32[]
panel indicators:
  "Tree": T1[]
  "Status string": string
  "URL Image": string
  "PrototypedBy": string
types:
  T1 = cluster{"Element 0": string, "Data": string, "Data_2": string}
  "List Packages Settings--cluster.gtype" = cluster{"PageNumber": i32, "SearchCriteria": string, "Filters": "Package Filters.gtype"}
  "List Details--cluster.gtype" = cluster{"TotalPackages": i32, "TotalPages": i32, "PagesBefore": i32, "PagesAfter": i32, "ItemsPerPage": i32}
  "Package--cluster.gtype" = cluster{"Name": string, "DisplayName": string, "RepoType": string, "RepoName": string, "Versions": "Package Version--cluster.gtype"[]}
  T2 = cluster{"BaseURL": string, "Settings": "List Packages Settings--cluster.gtype", "List Details": "List Details--cluster.gtype", "Packages": "Package--cluster.gtype"[], "All Tags": string[]}
uses:
  QMH support::Message Queue::Create All Message Queues.gviweb
  HTTP Client API::Base URL--constant.gvi
  QMH support::Message Queue::Dequeue Message.gviweb
  QMH support::Message Queue::Enqueue Message (Single).gviweb
  HTTP Client API::Connection::Open Connection.gvi
  HTTP Client API::Packages::List Packages.gvi
  HTTP Client API::Connection::Close Connection.gvi
  WebApp::Support::Format Packages for Tree Display.gvi
  HTTP Client API::Packages::Get Package Filters.gvi
  WebApp::Support::Build Status String.gvi
  RedirectURL::Redirect.jsli::Redirect
  NI::G Core::Error::Read Error Code.gvi
  Error Handling::Error Handler.gvi
  NI::G Core::Error::Build Error Cluster.gvi
  QMH support::Error Handler - Message Handling Loop.gviweb
  QMH support::Error Handler - Event Handling Loop.gviweb
diagram:
  w1 = bool TRUE  # Stop Event
  Create User Event[EventName="Stop Event"](user event data type=w1) -> (error out=w2, user event out=w3)
  call "Create All Message Queues.gviweb"(error in=w2) -> (message queues=w4, error out=w5)
  call "Base URL--constant.gvi"() -> (Base URL=w6)
  w7 = T2 {"BaseURL"="", "Settings"={"PageNumber"=1, "SearchCriteria"="", "Filters"={"RepoTypes"=[], "RepoNames"=[]}}, "List Details"={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}, "Packages"=[], "All Tags"=[]}
  Property Node(instance in=w7, "BaseURL"=w6) -> (instance out=w8)
  Property Node(instance in=w4) -> ("UI"=w9)
  s1 = w8  # shift register
  while {
    call "Dequeue Message.gviweb"(message queue in=w9, error in=w5) -> (message queue out=w10, message=w11, message data=w12, error out=w13)
    # s1: Data
    # w3: Stop Event
    case (w11) ignore case {  # Message Cases
      frame "Initialize" {
        Property Node(instance in=s1, "Settings:PageNumber"=1) -> (instance out=w15)
        Property Node(instance in=reference to "Tree", "ColumnHeaders"=["Name", "Vendor", "Repository"])
        call "Enqueue Message (Single).gviweb"(message queue in=w10, message="Get Filters", error in=w13) -> (message queue out=w17, error out=w18)
        call "Enqueue Message (Single).gviweb"(message queue in=w17, message="List Packages", error in=w18) -> (error out=w14)
        w16 = default
      }
      frame "List Packages" {
        Property Node(instance in=s1) -> ("BaseURL"=w19, "Settings"=w20, instance out=w21)
        Set Busy(reference in=reference to unnamed front panel, error in=w13) -> (reference out=w22, error out=w23)
        call "Open Connection.gvi"(Root URL=w19, error in=w23) -> (Connection=w24, error out=w25)
        call "List Packages.gvi"(Connection in=w24, List Packages Settings=w20, error in=w25) -> (Connection out=w26, Packages=w27, List Details=w28, error out=w29)
        Property Node(instance in=w21, "Packages"=w27, "List Details"=w28) -> (instance out=w15)
        call "Close Connection.gvi"(Connection in=w26, error in=w29) -> (error out=w30)
        Unset Busy(reference in=w22, error in=w30) -> (error out=w31)
        call "Enqueue Message (Single).gviweb"(message queue in=w10, message="Display Packages List", error in=w31) -> (error out=w14)
        w16 = default
      }
      frame "Display Packages List" {
        Property Node(instance in=s1) -> ("Packages"=w32, instance out=w33)
        Set Busy(reference in=reference to unnamed front panel, error in=w13) -> (reference out=w34, error out=w35)
        call "Format Packages for Tree Display.gvi"(Packages=w32, error in=w35) -> (Packages Tree=w36, All Tags=w37, error out=w38)
        $Tree <- w36
        Property Node(instance in=w33, "All Tags"=w37) -> (instance out=w15)
        Unset Busy(reference in=w34, error in=w38) -> (error out=w39)
        call "Enqueue Message (Single).gviweb"(message queue in=w10, message="Refresh Controls", error in=w39) -> (error out=w14)
        # Force reset scroll position
        Array Index(array=w37) -> (out0[0]=w40)
        Open Tree Item(reference in=reference to "Tree", location=w40) -> (reference out=w41)
        Close Tree Item(reference in=w41, location=w40)
        w16 = default
      }
      frame "Get Filters" {
        Property Node(instance in=s1) -> ("BaseURL"=w42, instance out=w43)
        Set Busy(reference in=reference to unnamed front panel, error in=w13) -> (reference out=w44, error out=w45)
        call "Open Connection.gvi"(Root URL=w42, error in=w45) -> (Connection=w46, error out=w47)
        call "Get Package Filters.gvi"(Connection in=w46, error in=w47) -> (Connection out=w48, Filters=w49, error out=w50)
        Property Node(instance in=w49) -> ("RepoTypes"=w51, "RepoNames"=w52)
        Array Index(array=w51) -> (out0[_]=w53)
        Build Array(w53) -> w54
        Array Index(array=w52) -> (out0[_]=w55)
        Build Array(w55) -> w56
        Property Node(instance in=w43, "Settings:Filters:RepoTypes"=w54, "Settings:Filters:RepoNames"=w56) -> (instance out=w15)
        Property Node(instance in=reference to "Repo Type", "Items"=w51, "Value"=[0])
        Property Node(instance in=reference to "Repo Name", "Items"=w52, "Value"=[0])
        call "Close Connection.gvi"(Connection in=w48, error in=w50) -> (error out=w57)
        Unset Busy(reference in=w44, error in=w57) -> (error out=w14)
        w16 = default
      }
      frame "Search value changed" {
        Property Node(instance in=s1) -> ("Settings"=w58, instance out=w59)
        Property Node(instance in=w58, "SearchCriteria"=w12, "PageNumber"=1) -> (instance out=w60)
        Property Node(instance in=w59, "Settings"=w60) -> (instance out=w15)
        Flatten To JSON(anything=w60) -> (JSON string=w61)
        call "Enqueue Message (Single).gviweb"(message queue in=w10, message="List Packages", message data=w61, error in=w13) -> (error out=w14)
        w16 = default
      }
      frame "Tree Selection Changed" {
        call "Enqueue Message (Single).gviweb"(message queue in=w10, message="Refresh Controls", error in=w13) -> (error out=w14)
        w15 = s1
        w16 = default
      }
      frame "Refresh Controls" {
        Build Array(reference to "First", reference to "Previous", reference to "Next", reference to "Last") -> w62
        Property Node(instance in=s1) -> ("List Details:PagesBefore"=w63, "List Details:PagesAfter"=w64, "Settings"=w65, "List Details"=w66, instance out=w15)
        Is Equal To 0(x=w63) -> w67
        case (w67) {
          frame False, Default {
            w68 = FALSE
            w69 = FALSE
          }
          frame True {
            w68 = TRUE
            w69 = TRUE
          }
        }
        Is Equal To 0(x=w64) -> w70
        case (w70) {
          frame False, Default {
            w71 = FALSE
            w72 = FALSE
          }
          frame True {
            w71 = TRUE
            w72 = TRUE
          }
        }
        Build Array(w68, w69, w71, w72) -> w73
        for {
          w74 = each element of w73
          w75 = each element of w62
          Property Node(instance in=w75, "Disabled"=w74)
        }
        call "Build Status String.gvi"(List Package settings=w65, List Details=w66) -> (Status String=w76)
        $"Status string" <- w76
        Property Node(instance in=reference to "Tree") -> ("SelectedData"=w77)
        Property Node(instance in=w77) -> ("Element 0"=w78)
        Is Empty String Or Path(string/path=w78) -> w79
        Property Node(instance in=reference to "Package Details", "Disabled"=w79)
        w14 = w13
        w16 = default
      }
      frame "Show Package Details" {
        Set Busy(reference in=reference to unnamed front panel, error in=w13) -> (reference out=w80, error out=w81)
        Property Node(instance in=s1) -> ("BaseURL"=w82, "Packages"=w83, "All Tags"=w84, instance out=w15)
        Property Node(instance in=reference to "Tree") -> ("SelectedData"=w85)
        Property Node(instance in=w85) -> ("Element 0"=w86)
        Search 1D Array(1D array=w84, element=w86) -> (index of element=w87)
        Array Index(array=w83) -> (out0[w87]=w88)
        Property Node(instance in=w88) -> ("Name"=w89)
        Concatenate Strings(w82, "Package?Name=", w89) -> w90
        call "Redirect"(URL=w90, target="_blank", error in=w81) -> (error out=w91)
        Unset Busy(reference in=w80, error in=w91) -> (error out=w14)
        w16 = default
      }
      frame "Repo Type changed" {
        Unflatten From JSON(JSON string=w12, type and defaults=i32[] []) -> (value=w92)
        Is Empty Array(array=w92) -> w93
        case (w93) {
          frame False, Default {
            w94 = w92
          }
          frame True {
            w94 = [0]
          }
        }
        Property Node(instance in=reference to "Repo Type", "Value"=w94) -> ("Items"=w95)
        for {
          w96 = each element of w94
          Array Index(array=w95) -> (out0[w96]=w98)
          append w98 to w97
        }
        Property Node(instance in=s1, "Settings:Filters:RepoTypes"=w97) -> (instance out=w15)
        call "Enqueue Message (Single).gviweb"(message queue in=w10, message="List Packages", error in=w13) -> (error out=w14)
        w16 = default
      }
      frame "Repo Name changed" {
        Unflatten From JSON(JSON string=w12, type and defaults=i32[] []) -> (value=w99)
        Is Empty Array(array=w99) -> w100
        case (w100) {
          frame False, Default {
            w101 = w99
          }
          frame True {
            w101 = [0]
          }
        }
        Property Node(instance in=reference to "Repo Name", "Value"=w101) -> ("Items"=w102)
        for {
          w103 = each element of w101
          Array Index(array=w102) -> (out0[w103]=w105)
          append w105 to w104
        }
        Property Node(instance in=s1, "Settings:Filters:RepoNames"=w104) -> (instance out=w15)
        call "Enqueue Message (Single).gviweb"(message queue in=w10, message="List Packages", error in=w13) -> (error out=w14)
        w16 = default
      }
      frame "First" {
        Property Node(instance in=s1) -> ("Settings"=w106, instance out=w107)
        Property Node(instance in=w106, "PageNumber"=1) -> (instance out=w108)
        Property Node(instance in=w107, "Settings"=w108) -> (instance out=w15)
        Flatten To JSON(anything=w108) -> (JSON string=w109)
        call "Enqueue Message (Single).gviweb"(message queue in=w10, message="List Packages", message data=w109, error in=w13) -> (error out=w14)
        w16 = default
      }
      frame "Last" {
        Property Node(instance in=s1) -> ("Settings"=w110, "List Details:TotalPages"=w111, instance out=w112)
        Property Node(instance in=w110, "PageNumber"=w111) -> (instance out=w113)
        Property Node(instance in=w112, "Settings"=w113) -> (instance out=w15)
        Flatten To JSON(anything=w113) -> (JSON string=w114)
        call "Enqueue Message (Single).gviweb"(message queue in=w10, message="List Packages", message data=w114, error in=w13) -> (error out=w14)
        w16 = default
      }
      frame "Previous" {
        Property Node(instance in=s1) -> ("Settings"=w115, "Settings:PageNumber"=w116, instance out=w117)
        Decrement(x=w116) -> w118
        Property Node(instance in=w115, "PageNumber"=w118) -> (instance out=w119)
        Property Node(instance in=w117, "Settings"=w119) -> (instance out=w15)
        Flatten To JSON(anything=w119) -> (JSON string=w120)
        call "Enqueue Message (Single).gviweb"(message queue in=w10, message="List Packages", message data=w120, error in=w13) -> (error out=w14)
        w16 = default
      }
      frame "Next" {
        Property Node(instance in=s1) -> ("Settings"=w121, "Settings:PageNumber"=w122, instance out=w123)
        Increment(x=w122) -> w124
        Property Node(instance in=w121, "PageNumber"=w124) -> (instance out=w125)
        Property Node(instance in=w123, "Settings"=w125) -> (instance out=w15)
        Flatten To JSON(anything=w125) -> (JSON string=w126)
        call "Enqueue Message (Single).gviweb"(message queue in=w10, message="List Packages", message data=w126, error in=w13) -> (error out=w14)
        w16 = default
      }
      frame "Error" {
        # Process Error
        w127 = no error  # Error
        Unflatten From JSON(JSON string=w12, error in (no error)=w13, type and defaults=w127) -> (error out=w14, value=w128)
        call "Read Error Code.gvi"(error in=w128) -> (code=w129)
        case (w129) {
          frame 501401 {
            # Redirect to Login page
            call "Redirect"(URL="Login.html")
          }
          frame 0, Default {
            # Display Error
            call "Error Handler.gvi"(error in=w128)
          }
        }
        w15 = s1
        w16 = default
      }
      frame "---Copy This Frame---" {
        Merge Errors(w13) -> (error out=w14)
        w15 = s1
        w16 = default
      }
      frame "Exit" {
        # Release the message queue reference
        Release Queue(error in=w13, queue=w10) -> (error out=w130)
        Generate User Event(event data=TRUE, user event=w3) -> (error out=w131)
        Merge Errors(w131, w130) -> (error out=w14)
        # Stop the VI
        w15 = s1
        w16 = TRUE
      }
      frame Default {
        w132 = "The invalid message string \"%s\" was received in the Message Handling Loop."
        Format Into String(formatString=w132, w11) -> w133
        call "Build Error Cluster.gvi"(code=1, description=w133) -> (error out=w14)
        w15 = s1
        w16 = default
      }
    }
    call "Error Handler - Message Handling Loop.gviweb"(message queue in=w10, error in=w14) -> (dup error in=w134)
    next s1 = w15
    stop if w16
  }
  Register For Events("Stop Event"=w3) -> (event registration refnum out=w135)
  s2 = w135  # shift register
  while {
    event (dynamic events = s2) {
      on dynamic event 0 {
        # The Message Handling Loop processed an "Exit" message, which fired this event to stop the Event Handling Loop.
        w136 = TRUE
        w137 = no error
        w138 = w9
      }
      on "Tree" Selection changed {
        Event Data() -> ("NewSelection"=w139)
        call "Enqueue Message (Single).gviweb"(message queue in=w9, message="Tree Selection Changed", message data=w139) -> (message queue out=w138, error out=w137)
        w136 = default
      }
      on "Search" Value changed {
        Event Data() -> ("New Value"=w140)
        call "Enqueue Message (Single).gviweb"(message queue in=w9, message="Search value changed", message data=w140) -> (message queue out=w138, error out=w137)
        w136 = default
      }
      on "First" Value changed {
        call "Enqueue Message (Single).gviweb"(message queue in=w9, message="First") -> (message queue out=w138, error out=w137)
        w136 = default
      }
      on "Last" Value changed {
        call "Enqueue Message (Single).gviweb"(message queue in=w9, message="Last") -> (message queue out=w138, error out=w137)
        w136 = default
      }
      on "Next" Value changed {
        call "Enqueue Message (Single).gviweb"(message queue in=w9, message="Next") -> (message queue out=w138, error out=w137)
        w136 = default
      }
      on "Previous" Value changed {
        call "Enqueue Message (Single).gviweb"(message queue in=w9, message="Previous") -> (message queue out=w138, error out=w137)
        w136 = default
      }
      on "Package Details" Value changed {
        call "Enqueue Message (Single).gviweb"(message queue in=w9, message="Show Package Details") -> (message queue out=w138, error out=w137)
        w136 = default
      }
      on "Repo Type" Value changed {
        Event Data() -> ("Old Value"=w141, "New Value"=w142)
        Is Equal[ComparisonMode=CompareAggregates](x=w141, y=[0]) -> w143
        case (w143) {
          frame False, Default {
            Search 1D Array(1D array=w141, element=0) -> (index of element=w145)
            case (w145) {
              frame -1 {
                Search 1D Array(1D array=w142, element=0) -> (index of element=w146)
                Is Greater Or Equal To 0(x=w146) -> w147
                Select(s=w147, t=[0], f=w142) -> w144
              }
              frame Default {
                Delete From Array(inArray=w142, index0=w145) -> w144
              }
            }
          }
          frame True {
            Search 1D Array(1D array=w142, element=0) -> (index of element=w148)
            Delete From Array(inArray=w142, index0=w148) -> w144
          }
        }
        Flatten To JSON(anything=w144) -> (JSON string=w149)
        call "Enqueue Message (Single).gviweb"(message queue in=w9, message="Repo Type changed", message data=w149) -> (message queue out=w138)
        w136 = default
        w137 = default
      }
      on "Repo Name" Value changed {
        Event Data() -> ("Old Value"=w150, "New Value"=w151)
        Is Equal[ComparisonMode=CompareAggregates](x=w150, y=[0]) -> w152
        case (w152) {
          frame False, Default {
            Search 1D Array(1D array=w150, element=0) -> (index of element=w154)
            case (w154) {
              frame -1 {
                Search 1D Array(1D array=w151, element=0) -> (index of element=w155)
                Is Greater Or Equal To 0(x=w155) -> w156
                Select(s=w156, t=[0], f=w151) -> w153
              }
              frame Default {
                Delete From Array(inArray=w151, index0=w154) -> w153
              }
            }
          }
          frame True {
            Search 1D Array(1D array=w151, element=0) -> (index of element=w157)
            Delete From Array(inArray=w151, index0=w157) -> w153
          }
        }
        Flatten To JSON(anything=w153) -> (JSON string=w158)
        call "Enqueue Message (Single).gviweb"(message queue in=w9, message="Repo Name changed", message data=w158) -> (message queue out=w138)
        w136 = default
        w137 = default
      }
    }
    call "Error Handler - Event Handling Loop.gviweb"(message queue in=w138, error in=w137) -> (dup error in=w159)
    stop if w136
  }
  Unregister For Events(error in=w159, event registration refnum=s2) -> (error out=w160)
  Merge Errors(w160, w134) -> (error out=w161)
  Destroy User Event(error in=w161, user event=w3)
