vi "Format Packages for Tree Display.gvi"   [LabVIEW NXG 4.0.0]
inputs:
  "Packages": "Package--cluster.gtype"[], required
  "error in": error
outputs:
  "Packages Tree": T1[]
  "error out": error
  "All Tags": string[]
types:
  "Package Version--cluster.gtype" = cluster{"ReleaseDate": string, "Version": string, "Name": string, "DisplayName": string, "Description": string, "Vendor": string, "Author": string, "Release Notes": string, "Dependencies": string[], "IconURL": string, "PackageURL": string, "RepoType": string, "RepoName": string}
  "Package--cluster.gtype" = cluster{"Name": string, "DisplayName": string, "RepoType": string, "RepoName": string, "Versions": "Package Version--cluster.gtype"[]}
  T1 = cluster{"Element 0": string, "Element 1": string, "Element 2": string}
diagram:
  for {
    w1 = each element of $Packages
    Property Node(instance in=w1) -> ("DisplayName"=w4, "Versions"=w5, "RepoName"=w6, "RepoType"=w7)
    Format Into String(formatString="%s (%s)", w6, w7) -> w8
    Array Index(array=w5) -> (out0[_]=w9)
    Property Node(instance in=w9) -> ("Vendor"=w10)
    Build Array(w4, w10, w8) -> w11
    Array To Cluster[NumberOfClusterElements=3](array=w11) -> (cluster=w12)
    append w12 to w2
    append w4 to w3
  }
  $"Packages Tree" <- w2
  $"All Tags" <- w3
  $"error out" <- $"error in"
